% Simulink data dictionary wiperData.sldd

wipermode_cmd = Simulink.Signal(StorageClass="ImportedExtern")
Servicemode_cmd = Simulink.Signal(StorageClass="ImportedExtern", DataType="boolean")
wiper_speed = Simulink.Signal(StorageClass="ExportedGlobal", DataType="uint8")
Intermittent_Delay = Simulink.Parameter("[ 0 to 5 ]", StorageClass="Const", DataType="string")
wiperspeed_low = Simulink.Parameter(50, StorageClass="Const", DataType="uint8")
Wiperspeed_high = Simulink.Parameter(100, StorageClass="Const", DataType="uint8")